# Grasshopper definition Color-Code-Graph.gh (Grasshopper 0.9.76)

c_script = CSharpScript(
    x="C:\Users\aheumann\Documents\vvd\RayToolDiff.dsx",
    update=Button(),
    clear=Button(),
    Reference="C:\Users\aheumann\Documents\vvd\VVD-GH-To-CG\CSharpCommonGraph\bin\Debug\CSharpCommonGraph.dll")  # -> out, A; inputs x: String, update: Boolean, clear: Boolean; disabled
# ---------- c_script: C# ----------
    DiffSet diffSet = DeserializeDiffSet(x);
    foreach(NodeChange nodeChange in diffSet.NodeChanges){
      switch(nodeChange.Status){
        case "added":
          Print("added");
          ColorObject(GrasshopperDocument, nodeChange.InstanceGuid, Color.Lime);
          Print(string.Format(" {0},{1} ", nodeChange.Position.X, nodeChange.Position.Y));
          showAddition(nodeChange.Position);
          break;
        case "removed":
          Print("removed");
          showDeletion(nodeChange.Position);
          Print(string.Format(" {0},{1} ", nodeChange.Position.X, nodeChange.Position.Y));
          ColorObject(GrasshopperDocument, nodeChange.InstanceGuid, Color.Red);
          break;
        case "changed":
          Print("changed");
          ColorObject(GrasshopperDocument, nodeChange.InstanceGuid, Color.Yellow);
          break;
      }
    }


    if(clear){
      foreach(Grasshopper.Kernel.Special.GH_Group grp in groupsAdded){
        GrasshopperDocument.Objects.Remove(grp);
      }
    }

    //   Color highlightColor = col;





    if(update){
      // ObjectsToColor(GrasshopperDocument, typeToFind, highlightColor);

    }

    A = this.Component;
# ---------- c_script: C# additional code ----------
  private static DiffSet DeserializeDiffSet(string path)
  {
    DiffSet diffFromFile;
    // Construct an instance of the XmlSerializer with the type
    // of object that is being deserialized.

    System.Xml.Serialization.XmlSerializer mySerializer =
      new System.Xml.Serialization.XmlSerializer(typeof(DiffSet));
    // To read the file, create a FileStream.
    using(FileStream myFileStream =
        new FileStream(path, FileMode.Open)){
      // Call the Deserialize method and cast to the object type.
      diffFromFile = (DiffSet)
        mySerializer.Deserialize(myFileStream);

    }
    return diffFromFile;


  }




  List<Grasshopper.Kernel.Special.GH_Group> groupsAdded = new List<Grasshopper.Kernel.Special.GH_Group>();
  List<bool> IsAlreadyInGroup(List<Guid> guids, List<Grasshopper.Kernel.Special.GH_Group> grps, Color col){
    List<bool> results = new List<bool>();
    foreach(Guid g in guids){
      results.Add(false);
    }
    foreach(Grasshopper.Kernel.Special.GH_Group grp in grps){ //for every group in the pre-existing groups
      if(grp.Objects().Count == 1){ //if that group only has one object in it
        for (int j = 0;j < guids.Count;j++){
          Guid g = guids[j];
          if(grp.ObjectIDs.Contains(g) && grp.Colour == col){
            results[j] = true;
            break;
          }
        }
      }
    }
    return results;
  }


  void ColorObject(GH_Document doc, string instanceGuid, Color highlightColor){

    List<Guid> guids = new List<Guid>();
    List<Grasshopper.Kernel.Special.GH_Group> grps = new List<Grasshopper.Kernel.Special.GH_Group>();
    List<Grasshopper.Kernel.Special.GH_Group> alreadygrps = new List<Grasshopper.Kernel.Special.GH_Group>();


    foreach(IGH_DocumentObject o in GrasshopperDocument.Objects){
      Grasshopper.Kernel.Special.GH_Group g = o as Grasshopper.Kernel.Special.GH_Group;
      if(g != null){

      }

      string typeName = o.GetType().ToString();
      if(o.InstanceGuid == new Guid(instanceGuid)){
        IGH_DocumentObject docObj = o as IGH_DocumentObject;

        guids.Add(docObj.InstanceGuid);
        Grasshopper.Kernel.Special.GH_Group grp = new Grasshopper.Kernel.Special.GH_Group();
        grp.Border = Grasshopper.Kernel.Special.GH_GroupBorder.Blob;
        grps.Add(grp);

      } else if (o is Grasshopper.Kernel.Special.GH_Group){
        Grasshopper.Kernel.Special.GH_Group alreadygrp = o as Grasshopper.Kernel.Special.GH_Group;
        alreadygrps.Add(alreadygrp);
      } else if( o is Grasshopper.Kernel.Special.GH_Cluster){
        Grasshopper.Kernel.Special.GH_Cluster clusterObj = o as  Grasshopper.Kernel.Special.GH_Cluster;



      }


    }





    List<bool> isAlreadyInGroup = IsAlreadyInGroup(guids, alreadygrps, highlightColor);

    for(int i = 0;i < grps.Count;i++){
      Grasshopper.Kernel.Special.GH_Group grp = grps[i];
      grp.Colour = highlightColor;
      grp.NickName = "";
      grp.AddObject(guids[i]);
      if(!isAlreadyInGroup[i]){
        grp.ExpireCaches();
        doc.AddObject(grp, false, 1000);
        groupsAdded.Add(grp);
      }
    }

  }


  void ObjectsToColor(GH_Document doc, string typeToFind, Color highlightColor){

    List<Guid> guids = new List<Guid>();
    List<Grasshopper.Kernel.Special.GH_Group> grps = new List<Grasshopper.Kernel.Special.GH_Group>();
    List<Grasshopper.Kernel.Special.GH_Group> alreadygrps = new List<Grasshopper.Kernel.Special.GH_Group>();


    foreach(IGH_DocumentObject o in GrasshopperDocument.Objects){
      Grasshopper.Kernel.Special.GH_Group g = o as Grasshopper.Kernel.Special.GH_Group;
      if(g != null){

      }

      string typeName = o.GetType().ToString();
      if(typeName == typeToFind){
        IGH_DocumentObject docObj = o as IGH_DocumentObject;

        guids.Add(docObj.InstanceGuid);
        Grasshopper.Kernel.Special.GH_Group grp = new Grasshopper.Kernel.Special.GH_Group();
        grp.Border = Grasshopper.Kernel.Special.GH_GroupBorder.Blob;
        grps.Add(grp);

      } else if (o is Grasshopper.Kernel.Special.GH_Group){
        Grasshopper.Kernel.Special.GH_Group alreadygrp = o as Grasshopper.Kernel.Special.GH_Group;
        alreadygrps.Add(alreadygrp);
      } else if( o is Grasshopper.Kernel.Special.GH_Cluster){
        Grasshopper.Kernel.Special.GH_Cluster clusterObj = o as  Grasshopper.Kernel.Special.GH_Cluster;
        if(clusterContainsComponent(clusterObj, typeToFind)){
          guids.Add(clusterObj.InstanceGuid);
          Grasshopper.Kernel.Special.GH_Group grp = new Grasshopper.Kernel.Special.GH_Group();
          grp.Border = Grasshopper.Kernel.Special.GH_GroupBorder.Blob;
          grps.Add(grp);
        }


      }


    }





    List<bool> isAlreadyInGroup = IsAlreadyInGroup(guids, alreadygrps, highlightColor);

    for(int i = 0;i < grps.Count;i++){
      Grasshopper.Kernel.Special.GH_Group grp = grps[i];
      grp.Colour = highlightColor;
      grp.NickName = "";
      grp.AddObject(guids[i]);
      if(!isAlreadyInGroup[i]){
        grp.ExpireCaches();
        doc.AddObject(grp, false, 1000);
        groupsAdded.Add(grp);
      }
    }


    // return guids;

  }


  bool clusterContainsComponent(Grasshopper.Kernel.Special.GH_Cluster cluster, string typeToFind){
    GH_Document clusterDoc = cluster.Document("");
    foreach(IGH_DocumentObject co in clusterDoc.Objects){

      string ctypeName = co.GetType().ToString();
      if(ctypeName == typeToFind){
        return true;

      } else if(co is Grasshopper.Kernel.Special.GH_Cluster) {
        return clusterContainsComponent(co as Grasshopper.Kernel.Special.GH_Cluster, typeToFind);
      }
    }
    return false;
  }

  void showDeletion(Position Pos){
    Circle C = new Circle(new Point3d(0, 0, 0), 60);
    Polyline P;
    C.ToNurbsCurve().ToPolyline(10, 3, 0.3, 0.5, 5.0, 0.1, 0.1, 1.0, false).TryGetPolyline(out P);
    createSketch(P, Color.Red, 4, new PointF((float) Pos.X, (float) Pos.Y));
  }

  void showAddition(Position Pos){
    Circle C = new Circle(new Point3d(0, 0, 0), 60);
    Polyline P;
    C.ToNurbsCurve().ToPolyline(10, 3, 0.3, 0.5, 5.0, 0.1, 0.1, 1.0, false).TryGetPolyline(out P);
    createSketch(P, Color.Lime, 4, new PointF((float) Pos.X, (float) Pos.Y));
  }


  void createSketch(Polyline P, Color c, int thickness, PointF location){
    Grasshopper.Kernel.Special.GH_Markup markup = new Grasshopper.Kernel.Special.GH_Markup();
    markup.Marks.Add(P);
    var newAtts = new Grasshopper.Kernel.Special.GH_MarkupAttributes(markup);

    newAtts.Width = thickness;
    newAtts.Colour = c;
    newAtts.DashPattern = Grasshopper.Kernel.Special.GH_MarkupAttributes.GH_MarkupDashPattern.DashDot;
    markup.Attributes = newAtts;

    GrasshopperDocument.AddObject(markup, false, GrasshopperDocument.ObjectCount);
    markup.Attributes.Pivot = location;
    markup.Attributes.ExpireLayout();
  }
# ---------- end c_script ----------
panel = Panel(c_script.out)
