# Grasshopper definition versionB2.ghx (Grasshopper 0.9.76)

subtraction = Subtraction(A=Slider(3, range=0..10), B=Slider(5, range=0..10))
stream_gate = StreamGate(Stream=subtraction, Gate=subtraction)  # -> Target0, Target1
number = Number(subtraction)
panel = Panel(number)
merge = Merge(Data1=stream_gate.Target0, Data2=stream_gate.Target1)
